% Simulink data dictionary APPTypes.sldd

DT_LoRateTxHiRateRx = Simulink.Bus(HeaderFile="Rte_Type.h")
  u8_OpMod_stMotAct: uint8
  u8_OpMod_stIvtrTar: uint8
  f32_SysLim_frqSwitchMax: single
  f32_VMCM_IdCmd_A: single
  f32_VMCM_IqCmd_A: single
  u8_VDSM_FltActn22_flg: uint8

DT_HiRateTxLoRateRx = Simulink.Bus(HeaderFile="Rte_Type.h")
  f32_DSS_uDCSide: single
  f32_RotS_nRot: single
  f32_RotS_agRot: single
  f32_PCS_iPaCS: single
  f32_PCS_iPbCS: single
  f32_PCS_iPcCS: single
  u8_PCS_bOverCurr: uint8
  f32_TorqEst_tqMotEst: single
  f32_CCM_uDVoltTar: single
  f32_CCM_uQVoltTar: single
  f32_CCM_iDCurrAct: single
  f32_CCM_iQCurrAct: single
  u8_Diag_bPhaCurrOverU: uint8
  u8_Diag_bPhaCurrOverV: uint8
  u8_Diag_bPhaCurrOverW: uint8
  u8_Diag1_b1_SumErr_null: uint8
  f32_VCCM_BattVolCirRadius_V: single
  f32_VCCM_VcmdBfLim_V: single
  f32_VMCM_TqAct_Nm: single
  u8_VDSM_FltActn12_flg: uint8

DT_CAN3_SG_FD3_VCU2 = Simulink.Bus(HeaderFile="Rte_Type.h")
  CAN3_CS_VCU2_CAN1: uint8
  CAN3_RC_VCU2_CAN1: uint8
  CAN3_Rr_ActvDmpDisabReq: uint8
  CAN3_Rr_IdcMax: uint16
  CAN3_Rr_IdcMin: uint16
  CAN3_Rr_MCUEnaReq: uint8
  CAN3_Rr_TMTqReq: uint16
  CAN3_Rr_TorqMax: uint16
  CAN3_Rr_TorqMin: uint16
  CAN3_Rr_UdcMax: uint16
  CAN3_Rr_UdcMin: uint16

DT_CAN3_SG_BMS1 = Simulink.Bus(HeaderFile="Rte_Type.h")
  CAN3_HVBattVolt: uint16

DT_CAN3_SG_BMS6 = Simulink.Bus(HeaderFile="Rte_Type.h")
  CAN3_HVBContactorSta: uint8

DT_CAN3_SG_FD3_C100_0 = Simulink.Bus(HeaderFile="Rte_Type.h")
  CAN3_BatteryMode: uint8
  CAN3_Rr_Coolantflow: uint8
  CAN3_Rr_Coolanttemp: uint16

DT_CAN3_SG_FD3_VCU1 = Simulink.Bus(HeaderFile="Rte_Type.h")
  CAN3_ActiveDischReq: uint8
  CAN3_CS_VCU1: uint8
  CAN3_PwrSta: uint8
  CAN3_RC_VCU1: uint8
  CAN3_ShiftGearPosn: uint8

DT_CAN3_SG_FD3_VCU5 = Simulink.Bus(HeaderFile="Rte_Type.h")
  CAN3_FDC_VCU_RrSpdMax_Req: uint16
  CAN3_FDC_VCU_RrSpdMin_Req: uint16
  CAN3_FDC_VCU_RrTMCtrlMode_Req: uint8
  CAN3_FDC_VCU_RrTMSpd_Req: uint16
  CAN3_FDC_VCU_RrTMTq_Req: uint16
  CAN3_FDC_VCU_RrTqMax_Req: uint16
  CAN3_FDC_VCU_RrTqMin_Req: uint16

DT_CAN3_SG_GW3_CE100_0 = Simulink.Bus(HeaderFile="Rte_Type.h")
  CAN3_IVI_Time_Day: uint8
  CAN3_IVI_Time_Hour: uint8
  CAN3_IVI_Time_Minute: uint8
  CAN3_IVI_Time_Month: uint8
  CAN3_IVI_Time_Second: uint8
  CAN3_VehSpeed: uint16

DT_CAN3_SG_MCU_B_R1 = Simulink.Bus(HeaderFile="Rte_Type.h")
  CAN3_MCUWarn_R: uint8
  CAN3_MCU_B_R_IGBTDdeTemp_Sta: uint16
  CAN3_MCU_B_R_RealPwrKw_Sta: uint16
  CAN3_Rr_ActvDmpDisabSta: uint8
  CAN3_Rr_EDUDrtSta: uint8
  CAN3_Rr_EDUOpratingSta: uint8
  CAN3_Rr_EDURealTMTq: uint16
  CAN3_Rr_EDURotateDirction: uint8
  CAN3_Rr_EDUTqReqFbk: uint16
  CAN3_Rr_MCU1Chksum: uint8
  CAN3_Rr_MCU1RolCnt: uint8
  CAN3_Rr_MCUBAT: uint8
  CAN3_Rr_MCUDCBusCurr: uint16
  CAN3_Rr_MCUDCBusVolt: uint16
  CAN3_Rr_MCUDischrgSta: uint8
  CAN3_Rr_MCUEnaSta: uint8
  CAN3_Rr_MCUErr: uint8
  CAN3_Rr_MCUIGN_sta: uint8
  CAN3_Rr_MCUReady: uint8
  CAN3_Rr_MCUReady4Pre: uint8
  CAN3_Rr_MCUSysSta: uint8
  CAN3_Rr_MCUTemp: uint16
  CAN3_Rr_MotorAvailTq: uint16
  CAN3_Rr_RegenAvailTq: uint16
  CAN3_Rr_Reserved_bits: uint8
  CAN3_Rr_TMSpd: uint16
  CAN3_Rr_TMTemp: uint16
  CAN3_Rr_TMid: uint16
  CAN3_Rr_TMiq: uint16

DT_CAN3_SG_MCU_B_R2 = Simulink.Bus(HeaderFile="Rte_Type.h")
  CAN3_MCU_B_R_FailLv_Sta: uint8
  CAN3_MCU_B_R_KL302TqCnt_Sta: uint8
  CAN3_MCU_B_R_LLCTempWarn_Sta: uint8
  CAN3_Rr_CoolanttempReq: uint16
  CAN3_Rr_Failcode1: uint8
  CAN3_Rr_Failcode2: uint8
  CAN3_Rr_Failcodehistory1: uint8
  CAN3_Rr_Failcodehistory2: uint8
  CAN3_Rr_LLCTemp: uint16
  CAN3_Rr_LLCflowReq: uint8
  CAN3_Rr_MCU2Chksum: uint8
  CAN3_Rr_MCU2RolCnt: uint8
  CAN3_Rr_MCU3_HW_Ver: uint16
  CAN3_Rr_MCU3_SW_Ver: uint16
  CAN3_Rr_MCUTempWarn: uint8
  CAN3_Rr_TMTempWarn: uint8

DT_CAN3_SG_MCU_FVT_R1 = Simulink.Bus(HeaderFile="Rte_Type.h")
  CAN3_MCU_FVT_R_BoostOP_Sta: uint8
  CAN3_MCU_FVT_R_EDUTqReq_Fbk: uint16
  CAN3_MCU_FVT_R_Failcode3_Sta: uint8
  CAN3_MCU_FVT_R_HeatingOP_Sta: uint8
  CAN3_MCU_FVT_R_MCUBAT_Sta: uint16
  CAN3_MCU_FVT_R_MCUErr_Sta: uint8
  CAN3_MCU_FVT_R_MCUSys_Sta: uint8
  CAN3_MCU_FVT_R_OilTemp_Sta: uint16
  CAN3_MCU_FVT_R_TMSpd_Sta: uint16

DT_CAN_MCU_R1_SG_EOP_FVT_R_Local1 = Simulink.Bus(HeaderFile="Rte_Type.h")
  CAN_MCU_R1_EOP_FVT_R_ActualSpd_Sta: uint16
  CAN_MCU_R1_EOP_FVT_R_CSInvalid_Sta: uint8
  CAN_MCU_R1_EOP_FVT_R_CanLoss_Sta: uint8
  CAN_MCU_R1_EOP_FVT_R_EnableOff_Sta: uint8
  CAN_MCU_R1_EOP_FVT_R_HallSigErr_Sta: uint8
  CAN_MCU_R1_EOP_FVT_R_Local1_CS_Sta: uint8
  CAN_MCU_R1_EOP_FVT_R_Local1_RC_Sta: uint8
  CAN_MCU_R1_EOP_FVT_R_OverTempBCK_Sta: uint8
  CAN_MCU_R1_EOP_FVT_R_OverTemp_Sta: uint8
  CAN_MCU_R1_EOP_FVT_R_OverVol_Sta: uint8
  CAN_MCU_R1_EOP_FVT_R_PumpReady_Sta: uint8
  CAN_MCU_R1_EOP_FVT_R_RCInvalid_Sta: uint8
  CAN_MCU_R1_EOP_FVT_R_RunStatus_Sta: uint8
  CAN_MCU_R1_EOP_FVT_R_StartFailure_Sta: uint8
  CAN_MCU_R1_EOP_FVT_R_UnderVol_Sta: uint8

DT_CAN_MCU_R1_SG_MCU_FVT_R_Local1 = Simulink.Bus(HeaderFile="Rte_Type.h")
  CAN_MCU_R1_MCU_FVT_R_Local1_CS_Sta: uint8
  CAN_MCU_R1_MCU_FVT_R_Local1_RC_Sta: uint8
  CAN_MCU_R1_MCU_FVT_R_OPCStartOn_Req: uint8
  CAN_MCU_R1_MCU_FVT_R_OilPmpTarSpd_Req: uint16